# Grasshopper definition HopsInput.gh (Grasshopper 1.0.7)

number_slider = Slider(20, range=0..100)
curve = GetGeometry(AtLeast=1, AtMost=2147483647, Filter=1074004029)
divisions = GetInteger(AtLeast=1, AtMost=2147483647, Maximum=2147483647, Minimum=-2147483648)
crv = Curve(<curve referenced from the Rhino model>)
divide = DivideCurve(Curve=curve, Count=divisions, Kinks=False)  # -> Points, Tangents, Parameters
rev = ReverseList(List=divide.Points)
ln = Line(StartPoint=divide.Points, EndPoint=rev)
context_bake = ContextBake(OutputLines=ln)
