# Grasshopper definition HopsOutputTest.gh (Grasshopper 1.0.7)
# plug-ins: Hops

geo = Geometry(<curve referenced from the Rhino model>)
crv = Curve(geo)
hops = Hops(
    Curve=crv,
    Divisions=Slider(5, range=0..10),
    CacheResultsInMemory=True,
    CacheSolveResults=True,
    RemoteDefinitionLocation="E:\MPDA\Sem02\AT\AT APY\HopsInput.gh",
    RemoteSolveVersion=(0, 1, 0),
    ShowInput_Enabled=False,
    ShowInput_Path=False,
    SynchronousSolve=True)
